# Grasshopper definition RoofIterations.gh (Grasshopper 0.9.76)
# plug-ins: Karamba, CORE.GH, Kangaroo Components, Weaverbird

# ---- group: InitialListOfPointsToTranslate
c_script = CSharpScript(x=Slider(0, range=0..1), y=Slider(0, range=0..1), z=Slider(0, range=0..1))  # -> out, A, B; inputs x: Double, y: Double, z: Double
# ---------- c_script: C# ----------
    var points = new Point3d[5];
    for(int i = 0; i < points.Length; ++i)
    {

      points[i] = new Point3d(x, y, z);

    }

    A = points;

    B = points[0];
    
    /*
    var plane = new Plane(points[0], new Vector3d(0, 0, 1));

    var circle = new Rhino.Geometry.Circle(plane, 1);

    var curve = circle.ToNurbsCurve();
    int numOfPoints = 5;
    var pointsCircle = new Point3d[numOfPoints];
    curve.DivideByCount(numOfPoints, true, out pointsCircle);

    C = pointsCircle;
    */
# ---------- end c_script ----------

# ---- group: InitialVector
vector_xyz = VectorXYZ(XComponent=Slider(11, range=0..100), YComponent=Slider(24, range=0..100), ZComponent=Slider(0, range=0..100))  # -> Vector, Length
construct_point = ConstructPoint(XCoordinate=0, YCoordinate=0, ZCoordinate=0)
amplitude = Amplitude(Vector=vector_xyz.Vector, Amplitude=Slider(11, range=0..100))
vector_display = VectorDisplay(Anchor=construct_point, Vector=amplitude)

# ---- group: TranslatePointsGenetically
gene_pool = GenePool(Decimals=2, Maximum=5, Minimum=0, Value=[4.12, 5, 5, 5, 4.63])
gene_pool_2 = GenePool(Decimals=2, Maximum=10, Minimum=0, Value=[4.27, 9.25, 6.52, 5.7, 7.47])
amplitude_2 = Amplitude(Vector=amplitude, Amplitude=gene_pool)
unit_z = UnitZ(Factor=1)
rotate = Rotate(Vector=amplitude_2, Axis=unit_z, Angle=gene_pool_2)
move = Move(Geometry=c_script.A, Motion=rotate)  # -> Geometry, Transform
vector_display_2 = VectorDisplay(Anchor=c_script.A, Vector=rotate)

# ---- group: ShiftList
c_script_2 = CSharpScript(x=move.Geometry)  # -> out, A; inputs x: list of Point3d; disabled
# ---------- c_script_2: C# additional code ----------
  //private Rhino.Display.CustomDisplay m_display = new Rhino.Display.CustomDisplay(true);
  // https://stackoverflow.com/questions/21385066/shifting-array-elements-to-right/21385610#21385610
  // updated so that instead of shifting integers it shifts the Point3d[] list
  public Point3d[] shiftLeft(Point3d[] arr)
  {
    Point3d[] demo = new Point3d[arr.Length];

    for (int i = 0; i < arr.Length - 1; i++)
    {
      demo[i] = arr[i + 1];
    }

    demo[demo.Length - 1] = arr[0];

    return demo;
  }
# ---------- end c_script_2 ----------
panel = Panel(c_script_2.A)  # disabled

# ----
unit_z_2 = UnitZ(Factor=1)
unit_z_3 = UnitZ(Factor=1)
unit_z_4 = UnitZ(Factor=1)
unit_z_5 = UnitZ(Factor=1)
unit_z_6 = UnitZ(Factor=1)

# ---- group: MeshClothSimulationGALAPAGOS
number_slider = Slider(0.309, range=0..1)

# ----
number_slider_2 = Slider(0.1, range=0..0.1)  # disabled

# ---- group: MeshClothSimulationGALAPAGOS / Simulation
construct_point_2 = ConstructPoint(XCoordinate=Slider(0, range=0..10), YCoordinate=Slider(0, range=0..10), ZCoordinate=Slider(0, range=0..10))
line = Line(StartPoint=construct_point_2, EndPoint=move.Geometry)
unit_z_7 = UnitZ(Factor=Slider(60.266, range=0..80))

# ---- group: CreateFloorPlan
number_slider_3 = Slider(0.72, range=0..10)
sortpointlist = CSharpScript(pointList=move.Geometry, tolerance=number_slider_3)  # -> out, A; inputs pointList: list of Point3d, tolerance: Double
# ---------- sortpointlist: C# ----------
    var points = new Point3d[pointList.Count];

    points = Rhino.Geometry.Point3d.SortAndCullPointList(pointList, tolerance);

    A = points;
# ---------- end sortpointlist ----------
polyline = PolyLine(Vertices=sortpointlist.A, Closed=True)
brep = Brep(polyline)
area = Area(Geometry=polyline)  # -> Area, Centroid
number = Number(area.Area)
panel_2 = Panel(number)

# ----
list_item = ListItem(List=sortpointlist.A, Index=0, Wrap=True)  # -> Item, Item1, Item2, Item3, Item4

# ---- group: MeshClothSimulationGALAPAGOS / Simulation (continued)
delaunay_mesh = DelaunayMesh(Points=flatten([construct_point_2, sortpointlist.A]), Plane=PlaneXY(0, 0, 0))
weld_mesh = WeldMesh(Mesh=delaunay_mesh, Angle=3.141592654)
weaverbird_s_loop_subdivision = WeaverbirdsLoopSubdivision(MeshCurves=weld_mesh, Level=3, SmoothNakedEdges=0)
weaverbird_s_catmull_clark_subdivision = WeaverbirdsCatmullClarkSubdivision(MeshCurves=weld_mesh, Level=1, SmoothNakedEdges=1)
deconstruct_mesh = DeconstructMesh(Mesh=weaverbird_s_loop_subdivision)  # -> Vertices, Faces, Colours, Normals
unaryforce = UnaryForce(Point=deconstruct_mesh.Vertices, Force=unit_z_7)
springsfrommesh = SpringsFromMesh(M=weaverbird_s_loop_subdivision, stiffness=1000, B=Slider(0.74784, range=0..1))
zombiekangaroo = ZombieKangaroo(
    ForceObjects=[springsfrommesh, unaryforce],
    AnchorPoints=sortpointlist.A,
    Settings=null,
    Geometry=weaverbird_s_loop_subdivision,
    Threshold=0.1,
    MaxIters=2000)  # -> Out, Iterations, ParticlesOut, GeometryOut, KE
mesh = Mesh(zombiekangaroo.GeometryOut)

# ----
sortpointlist_2 = CSharpScript(pointList=move.Geometry, tolerance=number_slider_3)  # -> out, A; inputs pointList: list of Point3d, tolerance: Double; same code as sortpointlist
shift_list = ShiftList(List=sortpointlist.A, Shift=1, Wrap=True)

# ---- group: Angles
vector_2pt = Vector2Pt(PointA=c_script.A, PointB=shift_list, Unitize=False)  # -> Vector, Length
vector_2pt_2 = Vector2Pt(PointA=c_script.A, PointB=sortpointlist.A, Unitize=False)  # -> Vector, Length
angle = Angle(VectorA=vector_2pt_2.Vector, VectorB=vector_2pt.Vector)  # -> Angle, Reflex
radianstodegrees = CSharpScript(Radians=angle.Angle)  # -> Degrees; inputs Radians: list of Double
# ---------- radianstodegrees: C# ----------
    var deg = new Double[Radians.Count];
    
    for( int i = 0; i < Radians.Count; ++i )
    {

      deg[i] = radToDeg(Radians[i]);

    }

    Degrees = deg;
# ---------- radianstodegrees: C# additional code ----------
  private double radToDeg(double rad)
  {

    double deg = 0.0;

    deg = rad * ( 180 / Math.PI );

    return deg;

  }
# ---------- end radianstodegrees ----------
number_slider_4 = Slider(0.2051, range=0..1)
panel_3 = Panel(radianstodegrees)
angular_dimension = AngularDimension(Center=c_script.A, PointA=sortpointlist.A, PointB=shift_list, Reflex=False, Text="{0:0.0}°", Size=number_slider_4)

# ---- group: CreateFloorPlan (continued)
vector_2pt_3 = Vector2Pt(PointA=sortpointlist.A, PointB=shift_list, Unitize=False)  # -> Vector, Length
panel_4 = Panel(vector_2pt_3.Length)
line_2 = Line(StartPoint=shift_list, EndPoint=sortpointlist.A)
vector_display_3 = VectorDisplay(Anchor=sortpointlist.A, Vector=vector_2pt_3.Vector)
line_dimension = LineDimension(Line=line_2, Text="{0:0.00}", Size=number_slider_4)

# ---- group: MeshClothSimulationGALAPAGOS / HighestPointArcs
mesh_edges = MeshEdges(Mesh=mesh)  # -> NakedEdges, InteriorEdges, NonManifoldEdges
curve = Curve(mesh_edges.NakedEdges)
number_slider_5 = Slider(5, range=0..10)
join_curves = JoinCurves(Curves=curve, Preserve=False)
list_length = ListLength(List=curve)
discontinuity = Discontinuity(Curve=join_curves, Level=1)  # -> Points, Parameters
division = Division(A=list_length, B=number_slider_5)
series = Series(Start=number_slider_5, Step=division, Count=number_slider_5)
list_item_2 = ListItem(List=discontinuity.Points, Index=series, Wrap=True)
brep_closest_point = BrepClosestPoint(Point=list_item_2, Brep=brep)  # -> Point, Distance
vector_2pt_4 = Vector2Pt(PointA=list_item_2, PointB=brep_closest_point.Point, Unitize=False)  # -> Vector, Length
line_3 = Line(StartPoint=list_item_2, EndPoint=brep_closest_point.Point)
vector_display_4 = VectorDisplay(Anchor=list_item_2, Vector=vector_2pt_4.Vector)
line_dimension_2 = LineDimension(Line=line_3, Text="{0:0.00}", Size=number_slider)

# ---- group: MeshClothSimulationGALAPAGOS / HighestPointMesh
deconstruct = Deconstruct(Point=zombiekangaroo.ParticlesOut)  # -> XComponent, YComponent, ZComponent
addition = Addition(A=deconstruct.ZComponent, B=Slider(1, range=0..10))
sort_list = SortList(Keys=addition, ValuesValuesA=zombiekangaroo.ParticlesOut)  # -> Keys, ValuesValuesA
list_length_2 = ListLength(List=sort_list.ValuesValuesA)  # -> expr("x-1", Length)
point_list = PointList(Points=sort_list.ValuesValuesA)
list_item_3 = ListItem(List=sort_list.ValuesValuesA, Index=list_length_2, Wrap=True)
brep_closest_point_2 = BrepClosestPoint(Point=list_item_3, Brep=brep)  # -> Point, Distance
line_4 = Line(StartPoint=list_item_3, EndPoint=brep_closest_point_2.Point)
vector_2pt_5 = Vector2Pt(PointA=list_item_3, PointB=brep_closest_point_2.Point, Unitize=False)  # -> Vector, Length
vector_display_5 = VectorDisplay(Anchor=list_item_3, Vector=vector_2pt_5.Vector)
line_dimension_3 = LineDimension(Line=line_4, Text="{0:0.00}", Size=number_slider)

# ----
line_5 = Line(StartPoint=list_item.Item4, EndPoint=brep_closest_point_2.Point)
line_6 = Line(StartPoint=list_item.Item3, EndPoint=brep_closest_point_2.Point)
line_7 = Line(StartPoint=list_item.Item1, EndPoint=brep_closest_point_2.Point)
line_8 = Line(StartPoint=list_item.Item2, EndPoint=brep_closest_point_2.Point)
line_9 = Line(StartPoint=list_item.Item, EndPoint=brep_closest_point_2.Point)
divide_curve = DivideCurve(Curve=line_5, Count=Slider(20, range=0..20), Kinks=False)  # -> simplify(flatten(Points)), Tangents, Parameters
divide_curve_2 = DivideCurve(Curve=line_6, Count=Slider(20, range=0..20), Kinks=False)  # -> simplify(flatten(Points)), Tangents, Parameters
divide_curve_3 = DivideCurve(Curve=line_7, Count=Slider(20, range=0..20), Kinks=False)  # -> simplify(flatten(Points)), Tangents, Parameters
divide_curve_4 = DivideCurve(Curve=line_8, Count=Slider(20, range=0..20), Kinks=False)  # -> simplify(flatten(Points)), Tangents, Parameters
divide_curve_5 = DivideCurve(Curve=line_9, Count=Slider(20, range=0..20), Kinks=False)  # -> simplify(flatten(Points)), Tangents, Parameters
mesh_ray = MeshRay(Mesh=mesh, Point=divide_curve.Points, Direction=unit_z_2)  # -> Point, Hit
mesh_ray_2 = MeshRay(Mesh=mesh, Point=divide_curve_2.Points, Direction=unit_z_3)  # -> Point, Hit
mesh_ray_3 = MeshRay(Mesh=mesh, Point=divide_curve_3.Points, Direction=unit_z_4)  # -> Point, Hit
mesh_ray_4 = MeshRay(Mesh=mesh, Point=divide_curve_4.Points, Direction=unit_z_5)  # -> Point, Hit
mesh_ray_5 = MeshRay(Mesh=mesh, Point=divide_curve_5.Points, Direction=unit_z_6)  # -> Point, Hit
closest_point = ClosestPoint(Point=mesh_ray.Point, Cloud=zombiekangaroo.ParticlesOut)  # -> ClosestPoint, CPIndex, Distance
closest_point_2 = ClosestPoint(Point=mesh_ray_2.Point, Cloud=zombiekangaroo.ParticlesOut)  # -> ClosestPoint, CPIndex, Distance
closest_point_3 = ClosestPoint(Point=mesh_ray_3.Point, Cloud=zombiekangaroo.ParticlesOut)  # -> ClosestPoint, CPIndex, Distance
closest_point_4 = ClosestPoint(Point=mesh_ray_4.Point, Cloud=zombiekangaroo.ParticlesOut)  # -> ClosestPoint, CPIndex, Distance
closest_point_5 = ClosestPoint(Point=mesh_ray_5.Point, Cloud=zombiekangaroo.ParticlesOut)  # -> ClosestPoint, CPIndex, Distance
smaller_than = SmallerThan(FirstNumber=closest_point.Distance, SecondNumber=Slider(0.245, range=0..1))  # -> SmallerThan, OrEqualTo
smaller_than_2 = SmallerThan(FirstNumber=closest_point_2.Distance, SecondNumber=Slider(0.245, range=0..1))  # -> SmallerThan, OrEqualTo
smaller_than_3 = SmallerThan(FirstNumber=closest_point_3.Distance, SecondNumber=Slider(0.245, range=0..1))  # -> SmallerThan, OrEqualTo
smaller_than_4 = SmallerThan(FirstNumber=closest_point_4.Distance, SecondNumber=Slider(0.245, range=0..1))  # -> SmallerThan, OrEqualTo
smaller_than_5 = SmallerThan(FirstNumber=closest_point_5.Distance, SecondNumber=Slider(0.245, range=0..1))  # -> SmallerThan, OrEqualTo
cull_pattern = CullPattern(List=closest_point.ClosestPoint, CullPattern=smaller_than.SmallerThan)
cull_pattern_2 = CullPattern(List=closest_point_2.ClosestPoint, CullPattern=smaller_than_2.SmallerThan)
cull_pattern_3 = CullPattern(List=closest_point_3.ClosestPoint, CullPattern=smaller_than_3.SmallerThan)
cull_pattern_4 = CullPattern(List=closest_point_4.ClosestPoint, CullPattern=smaller_than_4.SmallerThan)
cull_pattern_5 = CullPattern(List=closest_point_5.ClosestPoint, CullPattern=smaller_than_5.SmallerThan)
remove_duplicate_points = RemoveDuplicatePoints(InputPoints=flatten(cull_pattern), Tolerance=Slider(0.086396, range=0..1))  # -> OutputPoints, FirstPointIndexes
remove_duplicate_points_2 = RemoveDuplicatePoints(InputPoints=flatten(cull_pattern_2), Tolerance=Slider(0.086396, range=0..1))  # -> OutputPoints, FirstPointIndexes
remove_duplicate_points_3 = RemoveDuplicatePoints(InputPoints=flatten(cull_pattern_3), Tolerance=Slider(0.086396, range=0..1))  # -> OutputPoints, FirstPointIndexes
remove_duplicate_points_4 = RemoveDuplicatePoints(InputPoints=flatten(cull_pattern_4), Tolerance=Slider(0.086396, range=0..1))  # -> OutputPoints, FirstPointIndexes
remove_duplicate_points_5 = RemoveDuplicatePoints(InputPoints=flatten(cull_pattern_5), Tolerance=Slider(0.086396, range=0..1))  # -> OutputPoints, FirstPointIndexes
clean_tree = CleanTree(RemoveNulls=True, RemoveInvalid=True, RemoveEmpty=False, Tree=remove_duplicate_points.OutputPoints)  # -> simplify(Tree)
clean_tree_2 = CleanTree(RemoveNulls=True, RemoveInvalid=True, RemoveEmpty=False, Tree=remove_duplicate_points_2.OutputPoints)  # -> simplify(Tree)
clean_tree_3 = CleanTree(RemoveNulls=True, RemoveInvalid=True, RemoveEmpty=False, Tree=remove_duplicate_points_3.OutputPoints)  # -> simplify(Tree)
clean_tree_4 = CleanTree(RemoveNulls=True, RemoveInvalid=True, RemoveEmpty=False, Tree=remove_duplicate_points_4.OutputPoints)  # -> simplify(Tree)
clean_tree_5 = CleanTree(RemoveNulls=True, RemoveInvalid=True, RemoveEmpty=False, Tree=remove_duplicate_points_5.OutputPoints)  # -> simplify(Tree)
point = Point(flatten([clean_tree, list_item.Item4]))
point_2 = Point(flatten([clean_tree_2, list_item.Item3]))
point_3 = Point(flatten([clean_tree_3, list_item.Item1]))
point_4 = Point(flatten([clean_tree_4, list_item.Item2]))
point_5 = Point(flatten([clean_tree_5, list_item.Item]))
sortpointlist_3 = CSharpScript(pointList=point, tolerance=Slider(0.208, range=0..10))  # -> out, A; inputs pointList: list of Point3d, tolerance: Double; same code as sortpointlist
sortpointlist_4 = CSharpScript(pointList=point_2, tolerance=Slider(0.208, range=0..10))  # -> out, A; inputs pointList: list of Point3d, tolerance: Double; same code as sortpointlist
sortpointlist_5 = CSharpScript(pointList=point_3, tolerance=Slider(0.208, range=0..10))  # -> out, A; inputs pointList: list of Point3d, tolerance: Double; same code as sortpointlist
sortpointlist_6 = CSharpScript(pointList=point_4, tolerance=Slider(0.208, range=0..10))  # -> out, A; inputs pointList: list of Point3d, tolerance: Double; same code as sortpointlist
sortpointlist_7 = CSharpScript(pointList=point_5, tolerance=Slider(0.208, range=0..10))  # -> out, A; inputs pointList: list of Point3d, tolerance: Double; same code as sortpointlist

# ---- group: FitnessFunction
fitness = CSharpScript(
    area=number,
    lineLength=vector_2pt_3.Length,
    brep=brep,
    angle=radianstodegrees,
    zSize=vector_2pt_5.Length,
    arcSize=vector_2pt_4.Length)  # -> A; inputs area: Double, lineLength: list of Double, brep: Brep, angle: list of Double, zSize: Double, arcSize: list of Double
# ---------- fitness: C# ----------
    var lengths = lineLength.ToArray();
    var shift = shiftLeft(lengths);

    var angles = angle.ToArray();
    var shiftAngles = shiftLeft(angles);

    var douOut = area;

    if(lengths.Length != 5) douOut -= 500;

    for(int i = 0; i < lengths.Length; ++i)
    {

      if( (lengths[i]) == (shift[i]) || Math.Ceiling(lengths[i]) + 1 == Math.Ceiling(shift[i])  )
      {

        douOut -= 500;

      }


      if( lengths[i] == 0 )
      {

        douOut -= 500;

      }

      if( angles[i] == shiftAngles[i] )
      {

        douOut -= 500;

      }

      if( arcSize.ElementAt(i) < 2 )
      {

        douOut -= 500;

      }

    }

    if(brep == null)
    {

      douOut -= 500;

    }

    if(zSize < 3.5 || zSize > 4.1)
    {

      douOut -= 500;

    }

    A = douOut;
# ---------- fitness: C# additional code ----------
  //private Rhino.Display.CustomDisplay m_display = new Rhino.Display.CustomDisplay(true);
  // https://stackoverflow.com/questions/21385066/shifting-array-elements-to-right/21385610#21385610
  // updated so that instead of shifting integers it shifts the Point3d[] list
  public Double[] shiftLeft(Double[] arr)
  {
    Double[] demo = new Double[arr.Length];

    for (int i = 0; i < arr.Length - 1; i++)
    {
      demo[i] = arr[i + 1];
    }

    demo[demo.Length - 1] = arr[0];

    return demo;
  }
# ---------- end fitness ----------
galapagos = Galapagos(fitness=fitness, gene=[gene_pool, gene_pool_2])
panel_5 = Panel(fitness)

# ----
polyline_2 = PolyLine(Vertices=sortpointlist_7.A, Closed=False)
polyline_3 = PolyLine(Vertices=sortpointlist_5.A, Closed=False)
polyline_4 = PolyLine(Vertices=sortpointlist_6.A, Closed=False)
polyline_5 = PolyLine(Vertices=sortpointlist_4.A, Closed=False)
polyline_6 = PolyLine(Vertices=sortpointlist_3.A, Closed=False)

# ---- group: StructuralAnalysis
number_slider_6 = Slider(9.85, range=0..10)  # disabled
support_karamba = SupportKaramba(PosInd=sortpointlist.A, menu=[buttons(on, on, on, on, on, on)])  # disabled
mesh_to_shell_karamba = MeshToShellKaramba(Mesh=mesh, LimitDistance_m=0.005)  # -> Element, Points, Info; disabled
unit_z_8 = UnitZ(Factor=number_slider_6)  # disabled
loads_karamba = LoadsKaramba(Vector=unit_z_8, LCase=0, mode="Gravity")  # disabled
assemble_model_karamba = AssembleModelKaramba(
    Points=mesh_to_shell_karamba.Points,
    Elem=mesh_to_shell_karamba.Element,
    Support=support_karamba,
    Load=loads_karamba,
    LimitDistance_m=0.005)  # -> Model, Info, Mass_kg, CenterOfGravity; disabled
analyzethi_karamba = AnalyzeThIKaramba(Model=assemble_model_karamba.Model)  # -> CalculatedModel, MaximumDisplacement_m, ResultingForceOfGravity_kN, ElasticEnergy_kNm; disabled
shell_view_karamba = ShellViewKaramba(Model=analyzethi_karamba.CalculatedModel, IndexOfLayer=0)  # -> Model, MeshesOfRenderedShells, LegendColors, LegendTags; disabled

# ---- group: SurfaceFromMesh
deconstruct_mesh_2 = DeconstructMesh(Mesh=mesh)  # -> Vertices, Faces, Colours, Normals; disabled
weaverbird_s_face_polylines = WeaverbirdsFacePolylines(Mesh=mesh)
deconstruct_face = DeconstructFace(Face=deconstruct_mesh_2.Faces)  # -> CornerA, CornerB, CornerC, CornerD; disabled
list_item_4 = ListItem(List=deconstruct_mesh_2.Vertices, Index=deconstruct_face.CornerA, Wrap=True)  # disabled
list_item_5 = ListItem(List=deconstruct_mesh_2.Vertices, Index=deconstruct_face.CornerB, Wrap=True)  # disabled
list_item_6 = ListItem(List=deconstruct_mesh_2.Vertices, Index=deconstruct_face.CornerC, Wrap=True)  # disabled
surface = Surface(weaverbird_s_face_polylines)
_4point_surface = _4PointSurface(CornerA=list_item_4, CornerB=list_item_5, CornerC=list_item_6)  # disabled
brep_join = BrepJoin(Breps=surface)  # -> Breps, Closed
brep_join_2 = BrepJoin(Breps=_4point_surface)  # -> Breps, Closed; disabled
number_slider_7 = Slider(0, range=0..10)  # disabled
brep_wireframe = BrepWireframe(Brep=brep_join_2.Breps, Density=number_slider_7)  # disabled

# ---- group: MeshClothSimulationTIMER
delaunay_mesh_2 = DelaunayMesh(Points=flatten([construct_point_2, sortpointlist.A]), Plane=PlaneXY(0, 0, 0))  # disabled
weld_mesh_2 = WeldMesh(Mesh=delaunay_mesh_2, Angle=3.141592654)  # disabled
weaverbird_s_loop_subdivision_2 = WeaverbirdsLoopSubdivision(MeshCurves=weld_mesh_2, Level=3, SmoothNakedEdges=0)  # disabled
number_slider_8 = Slider(715.747, range=0..1000)  # disabled
unit_z_9 = UnitZ(Factor=number_slider_8)  # disabled
number_slider_9 = Slider(0.83104, range=0..1)  # disabled
deconstruct_mesh_3 = DeconstructMesh(Mesh=weaverbird_s_loop_subdivision_2)  # -> Vertices, Faces, Colours, Normals; disabled
unaryforce_2 = UnaryForce(Point=deconstruct_mesh_3.Vertices, Force=unit_z_9)  # disabled
springsfrommesh_2 = SpringsFromMesh(M=weaverbird_s_loop_subdivision_2, stiffness=1000, B=number_slider_9)  # disabled
boolean_toggle = BooleanToggle(False)  # disabled
timer = Timer(TimerInterval=20, Target=kangaroophysics)  # disabled
kangaroophysics = KangarooPhysics(
    ForceObjects=[unaryforce_2, springsfrommesh_2],
    AnchorPoints=sortpointlist.A,
    Settings=null,
    Geometry=weaverbird_s_loop_subdivision_2,
    SimulationReset=boolean_toggle)  # -> Out, Iterations, ParticlesOut, GeometryOut, KE; disabled
deconstruct_2 = Deconstruct(Point=kangaroophysics.ParticlesOut)  # -> XComponent, YComponent, ZComponent; disabled
number_slider_10 = Slider(10, range=0..10)  # disabled
mesh_2 = Mesh(kangaroophysics.GeometryOut)  # disabled
addition_2 = Addition(A=deconstruct_2.ZComponent, B=number_slider_10)  # disabled
deconstruct_mesh_4 = DeconstructMesh(Mesh=kangaroophysics.GeometryOut)  # -> Vertices, Faces, Colours, Normals; disabled
sort_list_2 = SortList(Keys=addition_2, ValuesValuesA=kangaroophysics.ParticlesOut)  # -> Keys, ValuesValuesA; disabled
deconstruct_face_2 = DeconstructFace(Face=deconstruct_mesh_4.Faces)  # -> CornerA, CornerB, CornerC, CornerD; disabled
list_item_7 = ListItem(List=deconstruct_mesh_4.Vertices, Index=deconstruct_face_2.CornerA, Wrap=True)  # disabled
list_item_8 = ListItem(List=deconstruct_mesh_4.Vertices, Index=deconstruct_face_2.CornerB, Wrap=True)  # disabled
list_item_9 = ListItem(List=deconstruct_mesh_4.Vertices, Index=deconstruct_face_2.CornerC, Wrap=True)  # disabled
list_length_3 = ListLength(List=sort_list_2.ValuesValuesA)  # -> expr("x-1", Length); disabled
point_list_2 = PointList(Points=sort_list_2.ValuesValuesA)  # disabled
_4point_surface_2 = _4PointSurface(CornerA=list_item_7, CornerB=list_item_8, CornerC=list_item_9)  # disabled
list_item_10 = ListItem(List=sort_list_2.ValuesValuesA, Index=list_length_3, Wrap=True)  # disabled
brep_closest_point_3 = BrepClosestPoint(Point=list_item_10, Brep=brep)  # -> Point, Distance; disabled
line_10 = Line(StartPoint=list_item_10, EndPoint=brep_closest_point_3.Point)  # disabled
is_planar = IsPlanar(Surface=_4point_surface_2, Interior=True)  # -> Planar, Plane; disabled
vector_2pt_6 = Vector2Pt(PointA=list_item_10, PointB=brep_closest_point_3.Point, Unitize=False)  # -> Vector, Length; disabled
line_dimension_4 = LineDimension(Line=line_10, Text="{0:0.00}", Size=1)  # disabled
vector_display_6 = VectorDisplay(Anchor=list_item_10, Vector=vector_2pt_6.Vector)  # disabled

# ---- group: Catenary
shift_list_2 = ShiftList(List=sortpointlist.A, Shift=1, Wrap=True)  # disabled
number_slider_11 = Slider(13, range=0..50)  # disabled
number_slider_12 = Slider(7, range=0..50)  # disabled
number_slider_13 = Slider(11.04, range=0..500)  # disabled
line_11 = Line(StartPoint=sortpointlist.A, EndPoint=shift_list_2)  # disabled
number_slider_14 = Slider(84, range=0..500)  # disabled
divide_curve_6 = DivideCurve(Curve=line, Count=number_slider_11, Kinks=True)  # -> Points, Tangents, Parameters; disabled
divide_curve_7 = DivideCurve(Curve=line_11, Count=number_slider_12, Kinks=True)  # -> Points, Tangents, Parameters; disabled
unit_z_10 = UnitZ(Factor=number_slider_13)  # disabled
unit_z_11 = UnitZ(Factor=number_slider_14)  # disabled
unaryforce_3 = UnaryForce(Point=divide_curve_6.Points, Force=unit_z_10)  # disabled
shatter = Shatter(Curve=line, Parameters=divide_curve_6.Parameters)  # disabled
number_slider_15 = Slider(0.848, range=0..10)  # disabled
shatter_2 = Shatter(Curve=line_11, Parameters=divide_curve_7.Parameters)  # disabled
end_points = EndPoints(Curve=line)  # -> Start, End; disabled
number_slider_16 = Slider(0.848, range=0..10)  # disabled
end_points_2 = EndPoints(Curve=line_11)  # -> Start, End; disabled
unaryforce_4 = UnaryForce(Point=divide_curve_7.Points, Force=unit_z_11)  # disabled
springsfromline = SpringsFromLine(
    Connection=shatter,
    Stiffness=1000,
    Damping=number_slider_15,
    RestLength=shatter,
    UpperCutoff=0,
    LowerCutoff=0,
    Plasticity=0)  # disabled
springsfromline_2 = SpringsFromLine(
    Connection=shatter_2,
    Stiffness=1000,
    Damping=number_slider_16,
    RestLength=shatter_2,
    UpperCutoff=0,
    LowerCutoff=0,
    Plasticity=0)  # disabled
boolean_toggle_2 = BooleanToggle(False)  # disabled
boolean_toggle_3 = BooleanToggle(False)  # disabled
kangaroophysics_2 = KangarooPhysics(
    ForceObjects=flatten([springsfromline, unaryforce_3]),
    AnchorPoints=[end_points.Start, end_points.End],
    Settings=null,
    Geometry=flatten(shatter),
    SimulationReset=boolean_toggle_2)  # -> Out, Iterations, ParticlesOut, GeometryOut, KE; disabled
kangaroophysics_3 = KangarooPhysics(
    ForceObjects=flatten([springsfromline_2, unaryforce_4]),
    AnchorPoints=[end_points_2.Start, end_points_2.End],
    Settings=null,
    Geometry=flatten(shatter_2),
    SimulationReset=boolean_toggle_3)  # -> Out, Iterations, ParticlesOut, GeometryOut, KE; disabled
timer_2 = Timer(TimerInterval=20, Target=kangaroophysics_2)  # disabled
timer_3 = Timer(TimerInterval=20, Target=kangaroophysics_3)  # disabled
number_slider_17 = Slider(4, range=0..4)  # disabled
point_6 = Point(kangaroophysics_2.ParticlesOut)  # disabled
partition_list = PartitionList(List=kangaroophysics_2.GeometryOut, Size=number_slider_11)  # -> simplify(Chunks); disabled
point_7 = Point(kangaroophysics_3.ParticlesOut)  # disabled
construct_path = ConstructPath(Indices=number_slider_17)  # disabled
polyline_7 = PolyLine(Vertices=point_7, Closed=True)  # disabled
tree_branch = TreeBranch(Tree=partition_list, Path=construct_path, MaintainPaths=True)  # disabled
partition_list_2 = PartitionList(List=kangaroophysics_3.GeometryOut, Size=number_slider_12)  # -> simplify(Chunks); disabled
number_slider_18 = Slider(4, range=0..4)  # disabled
join_curves_2 = JoinCurves(Curves=partition_list, Preserve=False)  # -> flatten(Curves); disabled
number_slider_19 = Slider(4, range=0..4)  # disabled
join_curves_3 = JoinCurves(Curves=partition_list_2, Preserve=False)  # -> flatten(Curves); disabled
construct_path_2 = ConstructPath(Indices=number_slider_18)  # disabled
list_item_11 = ListItem(List=join_curves_2, Index=number_slider_19, Wrap=True)  # disabled
tree_branch_2 = TreeBranch(Tree=partition_list_2, Path=construct_path_2, MaintainPaths=True)  # disabled
list_item_12 = ListItem(List=join_curves_3, Index=0, Wrap=True)  # disabled

# ----
area_2 = Area(Geometry=_4point_surface)  # -> Area, Centroid; disabled
evaluate_surface = EvaluateSurface(Surface=_4point_surface, Point=area_2.Centroid)  # -> Point, Normal, Frame; disabled
vector_2pt_7 = Vector2Pt(PointA=evaluate_surface.Normal, PointB=area_2.Centroid, Unitize=False)  # -> unitize(Vector), Length; disabled
multiplication = Multiplication(A=vector_2pt_7.Vector, B=number_slider_2)  # disabled
extrude = Extrude(Base=_4point_surface, Direction=multiplication)  # disabled
vector_display_7 = VectorDisplay(Anchor=area_2.Centroid, Vector=vector_2pt_7.Vector)  # disabled

# ==== cluster SpringsFromMesh: Turns all edges of a mesh into springs
M = ClusterInput()
medges = MeshEdges(Mesh=M)  # -> NakedEdges, InteriorEdges, NonManifoldEdges
crv = Curve([medges.NakedEdges, medges.InteriorEdges])
B = ClusterInput()
len = Length(Curve=crv)
multiplication = Multiplication(A=len, B=B)
stiffness = ClusterInput()
springs = SpringsFromLine(Connection=crv, Stiffness=stiffness, Damping=10, RestLength=multiplication, UpperCutoff=0, LowerCutoff=0, Plasticity=0)
S = ClusterOutput(springs)
